# Grasshopper definition tweetLandscape.ghx (Grasshopper 0.9.76)
# plug-ins: ghJSON

tweet_count_per_hash_x = Slider(10, range=0..10)
tweet_count_per_hash_y = Slider(10, range=0..10)
file_path = Panel("D:\Dropbox\Jose Luis\Twipology\10 - DEV\twipology\tweetData\1425256368597_tweets_parsed.json")
hash_count_x = Slider(4, range=0..10)
hash_count_y = Slider(3, range=0..10)
tweet_base_height_mm = Slider(10, range=0..100)
character_height_mm = Slider(5, range=0..50)
tweet_size_x_mm = Slider(100, range=0..500)
tweet_size_y_mm = Slider(150, range=0..500)
dam = DataDam(DataA=character_height_mm, BufferDelay=20000000, BufferMode=2)
dam_2 = DataDam(DataA=file_path, BufferDelay=20000000, BufferMode=2)

file = ReadFile(File=dam_2, PerLineParse=False)
txt = Text(file)

# ----
# USING ghJSON FOR GH:
# http://mathrioshka.ru/ghjson/
panel = Panel("{\"hashArray\":")
concat = Concatenate(FragmentA=panel, FragmentB=txt, FragmentC="}")
frmjson = FromJSON(JSON=concat)

jpath = JSONPath(JObject=frmjson, JSONPathQuery="$.hashArray[*].hashtag")
hashtags = Text(simplify(graft(jpath)))

lng = ListLength(List=jpath)
series = Series(Start=0, Step=1, Count=lng)
int = Integer(series)

# ---- group: TOO EXPENSIVE, BETTER COMPUTED INSIDE C# THAN READ FROM FILE
panel_2 = Panel("].tweets[*].text_length")  # disabled
panel_3 = Panel("$.hashArray[")  # disabled
concat_2 = Concatenate(FragmentA=panel_3, FragmentB=int, FragmentC=panel_2)  # disabled
jpath_2 = JSONPath(JObject=frmjson, JSONPathQuery=concat_2)  # disabled
tweet_length = Integer(simplify(jpath_2))  # disabled

panel_4 = Panel("].tweets[*].word_count")  # disabled
panel_5 = Panel("$.hashArray[")  # disabled
concat_3 = Concatenate(FragmentA=panel_5, FragmentB=int, FragmentC=panel_4)  # disabled
jpath_3 = JSONPath(JObject=frmjson, JSONPathQuery=concat_3)  # disabled
tweet_word_count = Integer(simplify(jpath_3))  # disabled

panel_6 = Panel("$.hashArray[*].tweets[*].chars[*]")  # disabled
jpath_4 = JSONPath(JObject=frmjson, JSONPathQuery=panel_6)  # disabled
flatten = FlattenTree(Tree=tweet_word_count, Path="{0}")  # disabled
ma = MassAddition(Input=flatten)  # -> Result, PartialResults; disabled
int_2 = Integer(jpath_4)  # disabled
panel_7 = Panel("-1")  # disabled
panel_8 = Panel("0")  # disabled
panel_9 = Panel("1")  # disabled
shift = ShiftList(List=flatten([panel_8, ma.PartialResults]), Shift=panel_7, Wrap=False)  # -> flatten(List); disabled
subtraction = Subtraction(A=ma.PartialResults, B=panel_9)  # disabled
graft = GraftTree(Tree=shift, IncludeEmptyLists=True, IncludeNullItems=True)  # -> simplify(Tree); disabled
graft_2 = GraftTree(Tree=subtraction, IncludeEmptyLists=True, IncludeNullItems=True)  # -> simplify(Tree); disabled
dom = ConstructDomain(DomainStart=graft, DomainEnd=graft_2)  # disabled
flatten_2 = FlattenTree(Tree=dom, Path="{0}")  # disabled
unflatten = UnflattenTree(Tree=flatten_2, Guide=tweet_word_count)  # disabled
subset = SubList(List=int_2, Domain=unflatten, Wrap=False)  # -> List, Index; disabled
tweet_word_chars = Integer(simplify(subset.List))  # disabled

# ----
concat_4 = Concatenate(FragmentA="$.hashArray[", FragmentB=int, FragmentC="].tweets[*].text")
jpath_5 = JSONPath(JObject=frmjson, JSONPathQuery=concat_4)
tweet_text = Text(simplify(jpath_5))

c_script = CSharpScript(
    hashCountX=hash_count_x,
    hashCountY=hash_count_y,
    tweetCountHashX=tweet_count_per_hash_x,
    tweetCountHashY=tweet_count_per_hash_y,
    tweetSizeX=tweet_size_x_mm,
    tweetSizeY=tweet_size_y_mm,
    tweetBaseHeight=tweet_base_height_mm,
    hashtags=hashtags,
    tweetText=tweet_text,
    charHeight=dam)  # -> out, meshes, A, B, C, D; inputs hashCountX: Int32, hashCountY: Int32, tweetCountHashX: Int32, tweetCountHashY: Int32, tweetSizeX: Double, tweetSizeY: Double, tweetBaseHeight: Double, hashtags: tree of String, tweetText: tree of String, charHeight: Double
# ---------- c_script: C# ----------
    DataTree<Tweet> tweets = new DataTree<Tweet>();

    // iterate over hashtag blocks
    for (int V = 0; V < hashCountY; V++) {
      for (int U = 0; U < hashCountX; U++) {
        int UV = V * hashCountX + U;
        GH_Path UVpath = new GH_Path(UV);

        List<string> tweetTxt = tweetText.Branch(UVpath);
        string hash = hashtags.Branch(UVpath)[0];

        // iterate over tweets in hashtag block
        for (int v = 0; v < tweetCountHashY; v++) {
          for (int u = 0; u < tweetCountHashX; u++) {
            int uv = v * tweetCountHashX + u;

            double x = U * tweetCountHashX * tweetSizeX + u * tweetSizeX;
            double y = V * tweetCountHashY * tweetSizeY + v * tweetSizeY;
            double z = 0;
            double baseElev = tweetBaseHeight;
            string txt = tweetTxt[uv];

            Tweet T = new Tweet(UV, uv, x, y, z, tweetSizeX, tweetSizeY, baseElev, charHeight, hash, txt);
            T.parseText();
            T.generateMesh();
            tweets.Add(T, UVpath);

          }
        }

      }
    }




    // Do something with the tweets

    DataTree<Point3d> tweetAnchors = new DataTree<Point3d>();
    DataTree<Mesh> tweetMeshes = new DataTree<Mesh>();

    // iterate over hashtag blocks
    for (int V = 0; V < hashCountY; V++) {
      for (int U = 0; U < hashCountX; U++) {
        int UV = V * hashCountX + U;
        GH_Path UVpath = new GH_Path(UV);
        List<Tweet> tweetList = tweets.Branch(UVpath);

        // iterate over tweets in hashtag block
        for (int v = 0; v < tweetCountHashY; v++) {
          for (int u = 0; u < tweetCountHashX; u++) {
            int uv = v * tweetCountHashX + u;
            GH_Path uvpath = new GH_Path(UV, uv);

            tweetAnchors.Add(tweetList[uv].anchor, UVpath);
            tweetMeshes.Add(tweetList[uv].mesh, UVpath);



          }
        }

      }
    }


    meshes = tweetMeshes;
    A = tweetAnchors;
# ---------- c_script: C# additional code ----------
  class Tweet {

    public int hashId, tweetId;

    public double x, y, z;
    public Point3d anchor;
    public double width, height;
    public double baseElevation, charHeight;

    public string hashtag;
    public string text;
    public int textLength;
    public int wordCount;
    public string[] words;
    public int[] wordChars;

    public Mesh mesh = new Mesh();

    public Tweet(int hashId_, int tweetId_, double x_, double y_, double z_, double w, double h, double baseElev, double charH, string hash, string txt) {
      hashId = hashId_;
      tweetId = tweetId_;
      x = x_;
      y = y_;
      z = z_;
      anchor = new Point3d(x, y, z);
      width = w;
      height = h;
      baseElevation = baseElev;
      charHeight = charH;
      hashtag = hash;
      text = txt;
    }

    public void parseText() {
      textLength = text.Length;
      words = text.Split(new Char [] {' '});
      wordCount = words.Length;
      wordChars = new int[wordCount];
      for (int i = 0; i < wordCount; i++) {
        wordChars[i] = words[i].Length;
      }
    }


    public void generateMesh() {
      // some sanity
      if (wordCount == 0) {
        generatePlanarMesh(baseElevation);
        return;
      }
      if (wordCount == 1) {
        generatePlanarMesh(baseElevation + wordChars[0] * charHeight);
        return;
      }

      // mesh with +1 words
      double stepY = height / (wordCount - 1);
      List<Point3d> verts = new List<Point3d>();
      for (int i = 0; i < wordCount; i++) {
        double yi = y + stepY * i;
        double zi = baseElevation + wordChars[i] * charHeight;
        verts.Add(new Point3d(x, yi, zi));
        verts.Add(new Point3d(x + width, yi, zi));
      }
      mesh.Vertices.AddVertices(verts);

      for (int i = 0; i < wordCount - 1; i++) {
        int I = 2 * i;
        mesh.Faces.AddFace(I, I + 1, I + 3, I + 2);
      }
      
      mesh.Normals.ComputeNormals();
      mesh.FaceNormals.ComputeFaceNormals();

    }


    void generatePlanarMesh(double elevation) {
      List<Point3d> verts = new List<Point3d>();
      verts.Add(new Point3d(anchor.X, anchor.Y, anchor.Z + elevation));
      verts.Add(new Point3d(anchor.X + width, anchor.Y, anchor.Z + elevation));
      verts.Add(new Point3d(anchor.X + width, anchor.Y + height, anchor.Z + elevation));
      verts.Add(new Point3d(anchor.X, anchor.Y + height, anchor.Z + elevation));
      mesh.Vertices.AddVertices(verts);

      mesh.Faces.AddFace(0, 1, 2, 3);

      mesh.Normals.ComputeNormals();
      mesh.FaceNormals.ComputeFaceNormals();

    }


  }
# ---------- end c_script ----------
geo = Geometry(c_script.A)
geo_2 = Geometry(c_script.meshes)
panel_10 = Panel(c_script.out)
flatten_3 = FlattenTree(Tree=geo_2, Path="{0}")
viewer = ParamViewer(c_script.A)
item = ListItem(List=flatten_3, Index=Slider(329, range=0..1000), Wrap=True)
